# Dynamo graph Dynamo Test.dyn (Dynamo 2.11.0.4533)

file_path = Filename("D:\KITURI\JAva\Projects\Dynamo\Nodes.xlsx")
file_from_path = FileObject()  # unwired: path
string = StringInput("Foaie1")
importExcel = Data.ImportExcel(file=file_from_path, sheetName=string)
transpose = List.Transpose(lists=importExcel)

# group: Nodes
nodeNumber = Python(IN[0]=transpose)  # CPython3
# ---------- nodeNumber.python (14 lines) ----------
# Load the Python Standard and DesignScript Libraries
import sys
import clr
clr.AddReference('ProtoGeometry')
from Autodesk.DesignScript.Geometry import *

# The inputs to this node will be stored as a list in the IN variables.
dataEnteringNode = IN

# Place your code below this line
for x in range(len(IN)): 
    y =IN[x][0]
# Assign your output to the OUT variable.
OUT = y
# ----------------------------------------
nodeX = Python(IN[0]=transpose)  # CPython3
# ---------- nodeX.python (14 lines) ----------
# Load the Python Standard and DesignScript Libraries
import sys
import clr
clr.AddReference('ProtoGeometry')
from Autodesk.DesignScript.Geometry import *

# The inputs to this node will be stored as a list in the IN variables.
dataEnteringNode = IN

# Place your code below this line
for x in range(len(IN)): 
    y =IN[x][1]
# Assign your output to the OUT variable.
OUT = y
# ----------------------------------------
nodeY = Python(IN[0]=transpose)  # CPython3
# ---------- nodeY.python (14 lines) ----------
# Load the Python Standard and DesignScript Libraries
import sys
import clr
clr.AddReference('ProtoGeometry')
from Autodesk.DesignScript.Geometry import *

# The inputs to this node will be stored as a list in the IN variables.
dataEnteringNode = IN

# Place your code below this line
for x in range(len(IN)): 
    y =IN[x][2]
# Assign your output to the OUT variable.
OUT = y
# ----------------------------------------
nodeZ = Python(IN[0]=transpose)  # CPython3
# ---------- nodeZ.python (14 lines) ----------
# Load the Python Standard and DesignScript Libraries
import sys
import clr
clr.AddReference('ProtoGeometry')
from Autodesk.DesignScript.Geometry import *

# The inputs to this node will be stored as a list in the IN variables.
dataEnteringNode = IN

# Place your code below this line
for x in range(len(IN)): 
    y =IN[x][3]
#    output to the OUT variable.
OUT = y
# ----------------------------------------

byCoordinates = Point.ByCoordinates(x=nodeX, y=nodeY, z=nodeZ)
code_block = CodeBlock {  }
file_path_2 = Filename("Start\structure.py")
readText = FileSystem.ReadText(file=file_path_2)
lista_manuala = CodeBlock()
# ---------- lista_manuala.designscript (6 lines) ----------
//list of X bays
OUT[0]=[0,3,6,9,14,19,21];
//list of Y bays
OUT[1]=[0,4,6.9,12,15];
//list of levels
OUT[2]=[0,2.8,5.6,8.4,11.2];
# ----------------------------------------

# group: X
number = DoubleInput(0)
number_slider_lungime = DoubleSlider(5, range=0..70 step 0.1)
number_slider_pas_deschidere = DoubleSlider(1, range=1..30 step 0.05)
range = Range(start=number, end=number_slider_lungime, step=number_slider_pas_deschidere)

# group: Y
number_2 = DoubleInput(0)
number_slider_latime = DoubleSlider(4, range=0..70 step 0.1)
number_slider_pas_travee = DoubleSlider(1, range=1..30 step 0.05)
range_2 = Range(start=number_2, end=number_slider_latime, step=number_slider_pas_travee)

# group: Z
number_3 = DoubleInput(0)
number_slider_inaltime = DoubleSlider(30, range=0..50 step 0.1)
number_slider_pas_nivel = DoubleSlider(2.85, range=1..12 step 0.05)
range_3 = Range(start=number_3, end=number_slider_inaltime, step=number_slider_pas_nivel)

lista_generata = CodeBlock(deschideri=range, travee=range_2, etaje=range_3) { OUT[0]=deschideri; OUT[1]=travee; OUT[2]=etaje; }
python_script_from_string = PythonStringNode(script=readText, IN[0]=lista_manuala.out0, IN[1]=lista_manuala.out1, IN[2]=lista_generata.out2)  # CPython3
code_block_2 = CodeBlock(py=python_script_from_string)  # frozen
# ---------- code_block_2.designscript (8 lines) ----------
//nodes
py[0];
//lines
py[1];
//slabs
py[2];
//walls
py[2];
# ----------------------------------------
