# Dynamo graph Test.dyn (Dynamo 2.13.1.3887)
# packages: Structural Analysis for Dynamo 2.11.0

file_path = Filename("D:\KITURI\JAva\Projects\Dynamo\Nodes.xlsx")
file_from_path = FileObject()  # unwired: path
string = StringInput("Foaie1")
importExcel = Data.ImportExcel(file=file_from_path, sheetName=string)
transpose = List.Transpose(lists=importExcel)

# group: Nodes
nodeNumber = Python(IN[0]=transpose)  # CPython3
# ---------- nodeNumber.python (14 lines) ----------
# Load the Python Standard and DesignScript Libraries
import sys
import clr
clr.AddReference('ProtoGeometry')
from Autodesk.DesignScript.Geometry import *

# The inputs to this node will be stored as a list in the IN variables.
dataEnteringNode = IN

# Place your code below this line
for x in range(len(IN)): 
    y =IN[x][0]
# Assign your output to the OUT variable.
OUT = y
# ----------------------------------------
nodeX = Python(IN[0]=transpose)  # CPython3
# ---------- nodeX.python (14 lines) ----------
# Load the Python Standard and DesignScript Libraries
import sys
import clr
clr.AddReference('ProtoGeometry')
from Autodesk.DesignScript.Geometry import *

# The inputs to this node will be stored as a list in the IN variables.
dataEnteringNode = IN

# Place your code below this line
for x in range(len(IN)): 
    y =IN[x][1]
# Assign your output to the OUT variable.
OUT = y
# ----------------------------------------
nodeY = Python(IN[0]=transpose)  # CPython3
# ---------- nodeY.python (14 lines) ----------
# Load the Python Standard and DesignScript Libraries
import sys
import clr
clr.AddReference('ProtoGeometry')
from Autodesk.DesignScript.Geometry import *

# The inputs to this node will be stored as a list in the IN variables.
dataEnteringNode = IN

# Place your code below this line
for x in range(len(IN)): 
    y =IN[x][2]
# Assign your output to the OUT variable.
OUT = y
# ----------------------------------------
nodeZ = Python(IN[0]=transpose)  # CPython3
# ---------- nodeZ.python (14 lines) ----------
# Load the Python Standard and DesignScript Libraries
import sys
import clr
clr.AddReference('ProtoGeometry')
from Autodesk.DesignScript.Geometry import *

# The inputs to this node will be stored as a list in the IN variables.
dataEnteringNode = IN

# Place your code below this line
for x in range(len(IN)): 
    y =IN[x][3]
#    output to the OUT variable.
OUT = y
# ----------------------------------------

byCoordinates = Point.ByCoordinates(x=nodeX, y=nodeY, z=nodeZ)
byPoint = DynamoSimulation.RSA.AnalyticalModel.AnalyticalNode.ByPoint()  # unwired: point
file_path_2 = Filename("Start\structure.py")
readText = FileSystem.ReadText(file=file_path_2)

# group: X
number = DoubleInput(0)
number_slider_lungime = DoubleSlider(20, range=0..100 step 0.1)
number_slider_pas_deschidere = DoubleSlider(4, range=1..10 step 0.05)
range = Range(start=number, end=number_slider_lungime, step=number_slider_pas_deschidere)

# group: Y
number_2 = DoubleInput(0)
number_slider_latime = DoubleSlider(30, range=0..100 step 0.1)
number_slider_pas_travee = DoubleSlider(6, range=1..10 step 0.05)
range_2 = Range(start=number_2, end=number_slider_latime, step=number_slider_pas_travee)

# group: Z
number_3 = DoubleInput(0)
number_slider_inaltime = DoubleSlider(12, range=0..240 step 0.1)
number_slider_pas_nivel = DoubleSlider(3, range=1..10 step 0.05)
range_3 = Range(start=number_3, end=number_slider_inaltime, step=number_slider_pas_nivel)

python_script_from_string = PythonStringNode(script=readText, IN[0]=range, IN[1]=range_2, IN[2]=range_3)  # CPython3
code_block = CodeBlock(input=python_script_from_string)
# ---------- code_block.designscript (6 lines) ----------
//points
input[0];
//lines
input[1];
//surfaces
//output[2];
# ----------------------------------------
code_block_2 = CodeBlock {  }
watch_3d = Watch3D(python_script_from_string)
